% Simulink data dictionary ros2lib.sldd

SL_Bus_geometry_msgs_Point = Simulink.Bus()  % MsgType=geometry_msgs/Point
  x: double
  y: double
  z: double

SL_Bus_std_srvs_EmptyRequest = Simulink.Bus()  % MsgType=std_srvs/EmptyRequest
  SL_DummyData: boolean

SL_Bus_std_srvs_EmptyResponse = Simulink.Bus()  % MsgType=std_srvs/EmptyResponse
  SL_DummyData: boolean