% Simulink data dictionary robotlib.sldd

SL_Bus_robotlib_geometry_msgs_Point = Simulink.Bus()  % MsgType=geometry_msgs/Point
  X: double
  Y: double
  Z: double

SL_Bus_robotlib_std_srvs_EmptyResponse = Simulink.Bus()  % MsgType=std_srvs/EmptyResponse
  SL_DummyData: boolean

SL_Bus_robotlib_std_srvs_EmptyRequest = Simulink.Bus()  % MsgType=std_srvs/EmptyRequest
  SL_DummyData: boolean

SL_Bus_robotlib_ros_time_Time = Simulink.Bus()  % MsgType=ros_time/Time
  Sec: double
  Nsec: double